# Dynamo graph AUDITORIA BASE-v3.dyn (Dynamo 2.1.0.7500)

# group: CADS LINKADOS
code_block = CodeBlock { "CAD importado"; }
element_types = ElementTypes("ImportInstance")
all_elements_of_type = ElementsOfType(element_type=element_types)
string = StringInput("is linked\n")
getParameterValueByName = Element.GetParameterValueByName(element=all_elements_of_type, parameterName=string)
code_block_2 = CodeBlock(x=getParameterValueByName) { x == 1; }
filterByBoolMask = List.FilterByBoolMask(list=all_elements_of_type, mask=code_block_2)
isEmpty = List.IsEmpty(list=filterByBoolMask.in)
code_block_3 = CodeBlock { ["Sem erros"]; }
teste_lógico = If(test=isEmpty, true=code_block_3, false=filterByBoolMask.in)
count = List.Count(list=teste_lógico)
ofRepeatedItem = List.OfRepeatedItem(item=code_block, amount=count)
id = Element.Id(element=teste_lógico)
string_from_object = FromObject(obj=id)
name = Element.Name(element=teste_lógico)
string_from_object_2 = FromObject(obj=name)
list_create = List.Create(item0=ofRepeatedItem, item1=string_from_object, item2=string_from_object_2)
transpose = List.Transpose(lists=list_create)

# group: FAMÍLIAS MODELADAS NO LOCAL
code_block_4 = CodeBlock { "FAMILIAS IN-PLACE"; }
auditoria_famílias_in_place = Python()  # unwired: IN[0]
# ---------- auditoria_famílias_in_place.python (27 lines) ----------
import clr
clr.AddReference('RevitAPI')
from Autodesk.Revit.DB import *

clr.AddReference('RevitServices')
import RevitServices
from RevitServices.Persistence import DocumentManager

# Acessar o documento atual
doc = DocumentManager.Instance.CurrentDBDocument

# Coletar todas as famílias no modelo
collector = FilteredElementCollector(doc).OfClass(Family)

# Filtrar apenas as famílias criadas "No Local" (In-Place)
in_place_families = [f for f in collector if f.IsInPlace]
in_place_instances = []

# Encontrar as instâncias (os elementos 3D) dessas famílias
for f in in_place_families:
    symbols = f.GetFamilySymbolIds()
    for sym_id in symbols:
        inst_collector = FilteredElementCollector(doc).WherePasses(FamilyInstanceFilter(doc, sym_id))
        in_place_instances.extend([i for i in inst_collector])

# Saída da lista de elementos para o Dynamo
OUT = in_place_instances
# ----------------------------------------
code_block_5 = CodeBlock(x=auditoria_famílias_in_place) { [x]; }
flatten = List.Flatten(list=code_block_5)
count_2 = List.Count(list=flatten)
ofRepeatedItem_2 = List.OfRepeatedItem(item=code_block_4, amount=count_2)
id_2 = Element.Id(element=flatten)
string_from_object_3 = FromObject(obj=id_2)
name_2 = Element.Name(element=flatten)
string_from_object_4 = FromObject(obj=name_2)
list_create_2 = List.Create(item0=ofRepeatedItem_2, item1=string_from_object_3, item2=string_from_object_4)
transpose_2 = List.Transpose(lists=list_create_2)

# group: COLETA DE AVISOS
python_script = Python()  # unwired: IN[0]
# ---------- python_script.python (30 lines) ----------
import clr
clr.AddReference("RevitServices")
from RevitServices.Persistence import DocumentManager

# Acessa o documento atual do Revit
doc = DocumentManager.Instance.CurrentDBDocument

# Coleta todos os avisos ativos no modelo
revit_warnings = doc.GetWarnings()

lista_textos_avisos = []
lista_elementos = []

# Varre cada aviso do modelo
for warning in revit_warnings:
    # Extrai o texto da descrição do aviso do Revit
    texto_descricao = warning.GetDescriptionText()
    
    # Extrai os IDs de todos os elementos associados a este aviso específico
    element_ids = warning.GetFailingElements()
    
    # Associa o texto do aviso a cada elemento individualmente (casamento de estrutura)
    for e_id in element_ids:
        elemento = doc.GetElement(e_id)
        if elemento:
            lista_textos_avisos.append(texto_descricao)
            lista_elementos.append(elemento)

# Retorna as duas listas organizadas: index 0 (textos) e index 1 (elementos)
OUT = [lista_textos_avisos, lista_elementos]
# ----------------------------------------
code_block_6 = CodeBlock(dados=python_script) { dados[0]; dados[1]; }
id_3 = Element.Id(element=code_block_6.out1)
string_from_object_5 = FromObject(obj=id_3)
code_block_7 = CodeBlock { "\n"; }
code_block_8 = CodeBlock { " "; }
replace = String.Replace(str=string_from_object_5, searchFor=code_block_7, replaceWith=code_block_8)
name_3 = Element.Name(element=code_block_6.out1)
string_from_object_6 = FromObject(obj=name_3)
code_block_9 = CodeBlock { "\n"; }
code_block_10 = CodeBlock { " "; }
replace_2 = String.Replace(str=string_from_object_6, searchFor=code_block_9, replaceWith=code_block_10)
list_create_3 = List.Create(item0=code_block_6.out0, item1=replace, item2=replace_2)
transpose_3 = List.Transpose(lists=list_create_3)

# group: EXPORTAÇÃO
join = List.Join(list0=transpose, list1=transpose_2, list2=transpose_3)
python_script_2 = Python(IN[0]=join)
# ---------- python_script_2.python (28 lines) ----------
# -*- coding: utf-8 -*-
import json
import os

# IN[0] recebe a lista de linhas vinda direto do List.Join
linhas_dados = IN[0]

dados_auditoria = []

# Garante que os dados existem antes de processar
if linhas_dados:
    for linha in linhas_dados:
        # Verifica se a linha é uma lista válida com Tipo, ID e Nome
        if isinstance(linha, list) and len(linha) >= 3:
            dados_auditoria.append({
                "erro": str(linha[0]),
                "id": str(linha[1]),
                "nome": str(linha[2])
            })

# Define o caminho do arquivo temporário no Windows
caminho_json = os.path.join(os.environ["USERPROFILE"], "AppData", "Local", "Temp", "auditoria_bim.json")

# Escreve o arquivo JSON que o pyRevit vai ler
with open(caminho_json, "w") as f:
    json.dump(dados_auditoria, f, indent=4)

OUT = "JSON gerado com sucesso! Pode rodar o botão no pyRevit."
# ----------------------------------------
