# Dynamo graph AUDITORIA BASE.dyn (Dynamo 2.1.0.7500)

# group: CADS LINKADOS
code_block = CodeBlock { "CAD importado"; }
element_types = ElementTypes("ImportInstance")
all_elements_of_type = ElementsOfType(element_type=element_types)
string = StringInput("is linked\n")
getParameterValueByName = Element.GetParameterValueByName(element=all_elements_of_type, parameterName=string)
code_block_2 = CodeBlock(x=getParameterValueByName) { x == 1; }
filterByBoolMask = List.FilterByBoolMask(list=all_elements_of_type, mask=code_block_2)
isEmpty = List.IsEmpty(list=filterByBoolMask.in)
code_block_3 = CodeBlock { ["Sem erros"]; }
teste_lógico = If(test=isEmpty, true=code_block_3, false=filterByBoolMask.in)
count = List.Count(list=teste_lógico)
ofRepeatedItem = List.OfRepeatedItem(item=code_block, amount=count)
id = Element.Id(element=teste_lógico)
string_from_object = FromObject(obj=id)
name = Element.Name(element=teste_lógico)
string_from_object_2 = FromObject(obj=name)
list_create = List.Create(item0=ofRepeatedItem, item1=string_from_object, item2=string_from_object_2)
transpose = List.Transpose(lists=list_create)

# group: FAMÍLIAS MODELADAS NO LOCAL
code_block_4 = CodeBlock { "FAMILIAS IN-PLACE"; }
auditoria_famílias_in_place = Python()  # unwired: IN[0]
# ---------- auditoria_famílias_in_place.python (27 lines) ----------
import clr
clr.AddReference('RevitAPI')
from Autodesk.Revit.DB import *

clr.AddReference('RevitServices')
import RevitServices
from RevitServices.Persistence import DocumentManager

# Acessar o documento atual
doc = DocumentManager.Instance.CurrentDBDocument

# Coletar todas as famílias no modelo
collector = FilteredElementCollector(doc).OfClass(Family)

# Filtrar apenas as famílias criadas "No Local" (In-Place)
in_place_families = [f for f in collector if f.IsInPlace]
in_place_instances = []

# Encontrar as instâncias (os elementos 3D) dessas famílias
for f in in_place_families:
    symbols = f.GetFamilySymbolIds()
    for sym_id in symbols:
        inst_collector = FilteredElementCollector(doc).WherePasses(FamilyInstanceFilter(doc, sym_id))
        in_place_instances.extend([i for i in inst_collector])

# Saída da lista de elementos para o Dynamo
OUT = in_place_instances
# ----------------------------------------
code_block_5 = CodeBlock(x=auditoria_famílias_in_place) { [x]; }
flatten = List.Flatten(list=code_block_5)
count_2 = List.Count(list=flatten)
ofRepeatedItem_2 = List.OfRepeatedItem(item=code_block_4, amount=count_2)
id_2 = Element.Id(element=flatten)
string_from_object_3 = FromObject(obj=id_2)
name_2 = Element.Name(element=flatten)
string_from_object_4 = FromObject(obj=name_2)
list_create_2 = List.Create(item0=ofRepeatedItem_2, item1=string_from_object_3, item2=string_from_object_4)
transpose_2 = List.Transpose(lists=list_create_2)

# group: COLETA DE AVISOS
string_2 = StringInput("\"AVISO DO REVIT\"")
coleta_de_avisos = Python()  # unwired: IN[0]
# ---------- coleta_de_avisos.python (13 lines) ----------
import clr
clr.AddReference('RevitAPI')
from Autodesk.Revit.DB import *
clr.AddReference('RevitServices')
from RevitServices.Persistence import DocumentManager

doc = DocumentManager.Instance.CurrentDBDocument
warnings = doc.GetWarnings()

descriptions = [w.GetDescriptionText() for w in warnings]
failing_elements = [[doc.GetElement(id) for id in w.GetFailingElements()] for w in warnings]

OUT = descriptions, failing_elements
# ----------------------------------------
code_block_6 = CodeBlock { 1; }
getItemAtIndex = List.GetItemAtIndex(list=coleta_de_avisos, index=code_block_6)
flatten_2 = List.Flatten(list=getItemAtIndex)
count_3 = List.Count(list=flatten_2)
ofRepeatedItem_3 = List.OfRepeatedItem(item=string_2, amount=count_3)
id_3 = Element.Id(element=flatten_2)
string_from_object_5 = FromObject(obj=id_3)
code_block_7 = CodeBlock { "\n"; }
code_block_8 = CodeBlock { " "; }
replace = String.Replace(str=string_from_object_5, searchFor=code_block_7, replaceWith=code_block_8)
name_3 = Element.Name(element=flatten_2)
string_from_object_6 = FromObject(obj=name_3)
code_block_9 = CodeBlock { "\n"; }
code_block_10 = CodeBlock { " "; }
replace_2 = String.Replace(str=string_from_object_6, searchFor=code_block_9, replaceWith=code_block_10)
list_create_3 = List.Create(item0=ofRepeatedItem_3, item1=replace, item2=replace_2)
transpose_3 = List.Transpose(lists=list_create_3)

# group: EXPORTAÇÃO
file_path = Filename(".\MODEL AUDIT.csv")
code_block_11 = CodeBlock()
# ---------- code_block_11.designscript (2 lines) ----------
["TIPO DE ERRO", "ID DO ELEMENTO", "NOME / DESCRICAO"
];
# ----------------------------------------
join = List.Join(list0=transpose, list1=transpose_2, list2=transpose_3)
code_block_12 = CodeBlock { 1; }
flatten_3 = List.Flatten(list=join, amt=code_block_12)
addItemToFront = List.AddItemToFront(item=code_block_11, list=flatten_3)
exportCSV = Data.ExportCSV(filePath=file_path, data=addItemToFront)
